# Grasshopper definition clips.gh (Grasshopper 1.0.7)

curve = Curve(<curve referenced from the Rhino model>)
unit_z = UnitZ(Factor=Slider(7, range=1..10))
extrude = Extrude(Base=curve, Direction=unit_z)
cap_holes = CapHoles(Brep=extrude)
