# Grasshopper definition nested objects.gh (Grasshopper 1.0.7)

number_of_copies = Slider(4, range=1..5)
null_vector = Vector(Vector(0, 0, 0))
curve = Curve(<curve referenced from the Rhino model>)
linear_array = LinearArray(Geometry=curve, Direction=null_vector, Count=number_of_copies)  # -> Geometry, Transform
series = Series(Start=1, Step=1, Count=number_of_copies)
panel = Panel(series)
panel_2 = Panel(linear_array.Geometry)
wallthickness = Slider(1.504, range=1..4)
scale = Scale(Geometry=linear_array.Geometry, Center=Point(0, 0, 0), Factor=series)  # -> Geometry, Transform
panel_3 = Panel(scale.Geometry)
panel_4 = Panel(scale.Transform)
offset_curve = OffsetCurve(Curve=scale.Geometry, Distance=wallthickness, Plane=PlaneXY(0, 0, 0), Corners=1)
panel_5 = Panel(offset_curve)
merge = Merge(Data1=graft(scale.Geometry), Data2=offset_curve)
boundary_surfaces = BoundarySurfaces(Edges=offset_curve)
wallheight = Slider(10, range=1..10)
panel_6 = Panel(merge)
boundary_surfaces_2 = BoundarySurfaces(Edges=merge)
unit_z = UnitZ(Factor=1)
unit_z_2 = UnitZ(Factor=wallheight)
extrude = Extrude(Base=boundary_surfaces_2, Direction=unit_z_2)
extrude_2 = Extrude(Base=boundary_surfaces, Direction=unit_z)
panel_7 = Panel(extrude)
panel_8 = Panel(extrude_2)
merge_2 = Merge(Data1=extrude, Data2=extrude_2)
solid_union = SolidUnion(Breps=merge_2)
panel_9 = Panel(merge_2)
panel_10 = Panel(solid_union)
